# Grasshopper definition MetaMAP_advanced.ghx (Grasshopper 1.0.8)
# plug-ins: MetaMAP

metatemplate = MetaTEMPLATE()
metatemplate_2 = MetaTEMPLATE()
number_slider = Slider(500, range=0..500)
metafetch = MetaFETCH(ShowMap=Button())  # -> Latitude, Longitude
metaupdate = MetaUPDATE(Update=Toggle(True))  # -> Status, YourVersion
metaterrain = MetaTERRAIN(Latitude=metafetch.Latitude, Longitude=metafetch.Longitude, Radius=number_slider, GridResolution="20")  # -> TerrainBrep, ElevationPoints, ElevationValues, Status
panel = Panel(metaupdate.Status)
metabuildingadvanced = MetaBuildingAdvanced(
    Latitude=metafetch.Latitude,
    Longitude=metafetch.Longitude,
    Radius=expr("x-100", number_slider),
    Terrain=metaterrain.TerrainBrep,
    Tiles="2")  # -> Buildings, DebugLog
panel_2 = Panel(metabuildingadvanced.DebugLog)
custom_preview = CustomPreview(Geometry=metabuildingadvanced.Buildings, Material=ColourSwatch(SwatchColor=RGB(255, 255, 255)))
custom_preview_2 = CustomPreview(Geometry=metaterrain.TerrainBrep, Material=ColourSwatch(SwatchColor=RGB(133, 133, 133)))
